# Grasshopper definition data_extract.gh (Grasshopper 1.0.7)
# plug-ins: RhinoCodePluginGH

pt = Point(<point referenced from the Rhino model>)
pt_2 = Point(<point referenced from the Rhino model>)
pt_3 = Point(<point referenced from the Rhino model>)
crv = Curve(<curve referenced from the Rhino model>)
S = Script(circle_area_point=pt_3, rectangle_area_point=pt_2, module_point=pt)  # -> out, circles, rectangles, rectangles_by_module; inputs x: Point3d, circle_area_point: Point3d
# ---------- S: Python ----------
"""Grasshopper Script"""

"""
#! python3
# r: numpy,pandas
import numpy
import pandas
print(pandas)
"""



import sys
import imp
import Rhino
import os
import types
import Rhino.Geometry as geo
import math
our_path = "C:\\PythonWork\\3-1"
sys.path.append(our_path)

def reload_package(package):
    fn = package.__file__
    fn_dir = os.path.dirname(fn) + os.sep
    module_visit = {fn}
    def reload_recursive_ex(module):
        imp.reload(module)
        for module_child in vars(module).values():
            if isinstance(module_child, types.ModuleType):
                fn_child = getattr(module_child, "__file__", None)
                if (fn_child and 
                fn_child.startswith(fn_dir) and 
                fn_child not in module_visit):
                    #print("reloading:", fn_child, "from", module)
                    module_visit.add(fn_child)
                    reload_recursive_ex(module_child)
    reload_recursive_ex(package)
import funcs
reload_package(funcs)
from funcs.extract import extract_data_to_dict, get_area, get_text_point, is_pt_inside

#data extract 하여서 dictionary로 변환합니다.
object_dict = extract_data_to_dict()

# A-TEXT, A-AREA 안에 있는 Object들을 꺼냅니다.
# 이 레이어는 각자 다를 수 있겠죠?
text_objects = object_dict["A-TEXT"]

text_geometry_list = [] 
for text_obj in text_objects:
    # 저의 경우에는 text_objects 안에 블록 객체가 섞여 있어서, 텍스트만 필터했습니다.
    if type(text_obj) == Rhino.DocObjects.TextObject:
        text = text_obj.TextGeometry.PlainText
        # 텍스트 내용 필터.
        if "CH" in text or "FL" in text or "SL" in text:
            pass
        else:
            text_geometry_list.append(text_obj.TextGeometry)
    



# 방 이름과 방 면적을 구성하는 리스트 
pairs = []
area_objects = object_dict["A-AREA"]
for area_curve in area_objects:
    curve_geometry = area_curve.CurveGeometry
    #area = str(round(get_area(curve_geometry) *0.0000001)) + ' M^2'
    area = get_area(curve_geometry)
    for text_geometry in text_geometry_list:
        comparison = is_pt_inside(get_text_point(text_geometry), curve_geometry)
        if comparison == True:
             pairs.append((text_geometry.PlainText, area))
            

print(pairs)

first_room_pair_list = ['거실','방1', '방2', '방3', '복도', '거실', '화장실1', '화장실2']
first_room_pair = [pair for pair in pairs if pair[0] in first_room_pair_list]
#pair[0] = 튜플의 앞부분, pair[1] = 튜플의 다음부분, pair[] = 전부 다 나옴
second_room_pair = [pair for pair in pairs if pair[0] not in first_room_pair_list]

print('*'*10)
def lambda_express(pair):
    return pair[1]
first_room_pair.sort(key = lambda_express)

print(first_room_pair)



#면적 원형 정렬
circle_center = circle_area_point
former_radius = 0
circles = []
for room_name, room_area in first_room_pair:
    radius = (room_area/math.pi)**(1/2)

    vec = geo.Vector3d(former_radius + radius,0,0)
    circle_center += vec
    former_radius = radius

    circles.append(geo.Circle(circle_center, radius))

"""
max_radius = max([circle.Radius for circle in circles])
for i, circle in enumerate(circles):
    dist = max_radius*2*i
    vec = geo.Vector3d(dist,0,0)
    circle.Translate(vec)
"""


#면적 사각형 정렬
rectangle_point = rectangle_area_point
former_length = 0
rectangles=[]
for room_name, room_area in first_room_pair:

    room_length = room_area**(1/2)
    vec_x = geo.Vector3d(room_length,0,0)
    vec_y = geo.Vector3d(0,room_length,0)
    
    vec = geo.Vector3d(former_length,0,0)
    rectangle_point += vec
    former_length = room_length
    
    pt1 = rectangle_point
    pt2 = rectangle_point + vec_x
    pt3 = rectangle_point + vec_x + vec_y
    pt4 = rectangle_point + vec_y

    rectangles.append(geo.PolylineCurve([pt1,pt2,pt3,pt4,pt1]))

   
# 최적의 모듈찾기
module_options = [6000, 6500, 7000, 7500, 8000, 8100, 8400, 8500] 

def evaulate_module(module_option):
    module_area = module_option **2
    area_left_list = []
    for room_name, room_area in first_room_pair:
        area_left = room_area % (module_area/2)
        area_left_list.append(area_left)
    return sum(area_left_list)
module_options_sorted = sorted(module_options , key = evaulate_module)

selected_module = module_options_sorted[0]
rectangles_by_module = []
x_dists = [] 
for room_name, room_area in first_room_pair:
    half_module_count = int(room_area / ((selected_module**2)/2))
    module_count = half_module_count/2

    vec_y = geo.Vector3d(0, selected_module,0)
    vec_x = geo.Vector3d(selected_module * module_count, 0,0)
    origin_point = module_point
    x_dists.append(selected_module * module_count)

    pt1 = origin_point + vec_x
    pt2 = origin_point + vec_x + vec_y
    pt3 = origin_point + vec_y
    pt4 = origin_point

    rectangles_by_module.append(geo.PolylineCurve([pt1,pt2,pt3,pt4,pt1]))
    

for i, rectangle in enumerate(rectangles_by_module):
    dist_to_move = 0
    for x in range(i):
        dist_to_move += x_dists[x]
    vec = geo.Vector3d(dist_to_move,0,0)
    rectangle.Translate(vec)
# ---------- end S ----------
crv_2 = Curve(<curve referenced from the Rhino model>)
S_2 = Script(room=crv_2, obstacle=crv, index=Slider(20, range=0..100))  # -> out, circle_extrusions, score_for_color; inputs room: Curve, obstacle: Curve
# ---------- S_2: Python ----------
import sys
import os
import Rhino.Geometry as geo

import math
our_path = "C:\\PythonWork\\3-1"
sys.path.append(our_path)
from funcs.extract import is_pt_inside

box = room.GetBoundingBox(geo.Plane.WorldXY)
origin_point = box.Min

height = box.Max.Y - box.Min.Y
width = box.Max.X - box.Min.X
step = 5000

vec_x = geo.Vector3d(step,0,0)
vec_y = geo.Vector3d(0,step,0)

x_count = math.ceil(width / step)
y_count = math.ceil(height / step)

points = []
for x_index in range(x_count):
    for y_index in range(y_count):
        point = origin_point + x_index*vec_x + y_index*vec_y
        if is_pt_inside(point, room):
            points.append(point)

point_score_tuple_list = []
for check_point in points:
    lines_on_point = []
    for point2 in points:
        if check_point !=point2:
            check_line = geo.LineCurve(check_point,point2)
            curve_intersections = geo.Intersect.Intersection.CurveCurve(check_line, obstacle, 0.1 ,0.1)
            if curve_intersections.Count == 0:
                lines_on_point.append(check_line)
    score = len(lines_on_point)
    point_score_tuple_list.append((check_point,score))

scores = [score_tuple[1] for score_tuple in point_score_tuple_list] 

max_core=max(scores)
min_score=min(scores)

score_minus_min = [score -min_score for score in scores]
score_normalized = [score /max(score_minus_min) for score in score_minus_min]

score_for_color = [int(score * 255) for score in score_normalized]

radius = step/2
circles = [geo.Circle(point, radius) for point in points]

height = 5
circle_extrusions = [geo.Extrusion.Create(circle.ToNurbsCurve(), height, True) for circle in circles]
print(circle_extrusions)
            

#room 과 obstacle이 같은 객체일때
#문으로 뚫린부분이 있는 경우까지 생각
# ---------- end S_2 ----------
crv_3 = Curve(S.circles)
crv_4 = Curve(S.rectangles)
crv_5 = Curve(S.rectangles_by_module)
rgb = ColourRGB(Alpha=255, Red=S_2.score_for_color, Green=0, Blue=S_2.score_for_color)
material = CreateMaterial(Diffuse=rgb, Specular=RGB(255, 255, 255), Emission=RGB(0, 0, 0), Transparency=0, Shine=0)
preview = CustomPreview(Geometry=S_2.circle_extrusions, Material=material)
