# Grasshopper definition 0113work.gh (Grasshopper 1.0.7)
# plug-ins: RhinoCodePluginGH

point = Point(Point(64178, 30168, 0))
point_2 = Point(graft(point))
point_3 = Point(Point(321348, 163199.3455, 0))
point_4 = Point(<point referenced from the Rhino model>)
curve = Curve([<curve referenced from the Rhino model> x20])
curve_2 = Curve([<curve referenced from the Rhino model> x20])
point_5 = Point(Point(321348, 163199.3455, 0))
script = Script(x=curve_2, first_floor_point=point_5)  # -> out, circles, rectangles, momdule_rectangles; inputs first_floor_point: Point3d
# ---------- script: Python ----------
# -*- coding: utf-8 -*-

import rhinoscriptsyntax as rs
import scriptcontext
import Rhino
import sys
import os
import types
import imp
import math
import Rhino.Geometry as geo

our_path = "C:\\Users\\PC\\Documents\\0104workshop"
sys.path.append(our_path)

import imp
import funcs
imp.reload(funcs)
from funcs import extract
print(extract)

our_path = "C:\\Users\\PC\\Documents\\0104workshop"
sys.path.append(our_path)

import funcs

def reload_package(package):
    fn = package.__file__
    fn_dir = os.path.dirname(fn) + os.sep
    module_visit = {fn}
    def reload_recursive_ex(module):
        imp.reload(module)
        for module_child in vars(module).values():
            if isinstance(module_child, types.ModuleType):
                fn_child = getattr(module_child, "__file__", None)
                if (fn_child and 
                fn_child.startswith(fn_dir) and 
                fn_child not in module_visit):
                    module_visit.add(fn_child)
                    reload_recursive_ex(module_child)
    reload_recursive_ex(package)

import funcs
reload_package(funcs)
from funcs.extract import extract_data_to_dict, get_area, get_text_point, is_pt_inside

# 현재 Rhino 문서를 스크립트 컨텍스트의 활성 문서로 설정
scriptcontext.doc = Rhino.RhinoDoc.ActiveDoc

def find_closest_text_to_curve(curve_id, text_objects):
    # 폐곡선의 중심점 찾기
    curve_centroid = rs.CurveAreaCentroid(curve_id)[0]
    
    # 모든 텍스트 중 가장 가까운 것 찾기
    closest_text = None
    min_distance = float('inf')
    
    for text_id in text_objects:
        text_point = rs.TextObjectPoint(text_id)
        distance = rs.Distance(curve_centroid, text_point)
        
        if distance < min_distance:
            min_distance = distance
            closest_text = text_id
    
    return closest_text

def calculate_area_of_closed_curves(layer_name, text_objects):
    # 해당 레이어의 모든 폐곡선 가져오기
    curves = rs.ObjectsByLayer(layer_name, rs.filter.curve)
    
    # 결과를 저장할 딕셔너리 초기화
    result_list = []

    # 각 폐곡선에 대해 면적 계산 및 딕셔너리에 추가
    for curve_id in curves:
        closest_text_id = find_closest_text_to_curve(curve_id, text_objects)
        curve_area = rs.Area(curve_id)
        
        # 텍스트 내용 가져오기
        closest_text = rs.TextObjectText(closest_text_id)
        
        # 제외 조건: "C.H" 또는 "G.L"이 포함된 텍스트는 제외
        if "C.H" in closest_text or "G.L" in closest_text:
            continue
        
        '''# 현재 모델의 단위를 고려하여 제곱미터로 변환
        model_unit = rs.UnitSystem()
        if model_unit == 2:  # Assuming model is in millimeters
            curve_area /= 1000000  # Convert from square millimeters to square meters
        
        '''
        # 소수점 아래 자리를 버리고 면적을 정수로 변환
        curve_area = int(curve_area)
        
        # 결과 리스트에 추가
        result_list.append({"text": closest_text, "area": curve_area})
    
    return result_list, curves

def calculate_rectangle_area(length, width):
    """직사각형의 길이와 너비를 이용하여 면적을 계산합니다."""
    return length * width

layer_name = "work_area"  # 사용하려는 레이어의 이름으로 변경

# 텍스트 객체 가져오기
text_objects = rs.ObjectsByLayer("work_text", rs.filter.annotation)

# calculate_area_of_closed_curves 함수 호출하여 결과 및 curves 리스트 가져오기
result_list, curves = calculate_area_of_closed_curves(layer_name, text_objects)

# 결과 출력
for entry in result_list:
    print(f"[{entry['text']}:{entry['area']}]")

# Rhino 문서를 원래대로 복원
scriptcontext.doc = ghdoc

# first_floor_rooms 리스트 생성
first_floor_room_list = [room_dict["text"] for room_dict in result_list]
first_floor_rooms = [room_dict for room_dict in result_list if room_dict["text"] in first_floor_room_list]
print(first_floor_rooms)

# 면적 기준으로 first_floor_rooms 정렬
first_floor_rooms_sorted = sorted(first_floor_rooms, key=lambda x: x["area"], reverse=True)
print("Sorted First Floor Rooms:")
for entry in first_floor_rooms_sorted:
    print(f"[{entry['text']}:{entry['area']}]")

# 동그란 방 만들기
first_floor_point = geo.Point3d(0, 0, 0)  # 시작점 초기화
former_radius = 0
centers = []
circles = []

'''# 각 방에 대해 반지름 계산하고 원을 생성
for room_dict in result_list:
    room_name = room_dict["text"]
    room_area = room_dict["area"]
    
    radius = math.sqrt(room_area / math.pi)
    vec = geo.Vector3d(former_radius + radius, 0, 0)
    first_floor_point += vec
    former_radius = radius
    
    centers.append(first_floor_point)
    circles.append(geo.Circle(first_floor_point, radius))'''
# rectangles_sorted 리스트 생성
rectangles_sorted = []
# 시작점 초기화
first_floor_point = geo.Point3d(0, 0, 0)
former_length = 0

# 정렬된 방에 대해 반복
for room_dict in first_floor_rooms_sorted:
    room_name = room_dict["text"]
    room_area = room_dict["area"]

    # 면적을 기반으로 직사각형의 한 변의 길이 계산
    room_length = math.sqrt(room_area)

    # 평행이동을 위한 벡터 생성
    vec = geo.Vector3d(former_length, 0, 0)

    # 다음 사각형의 시작점 업데이트
    first_floor_point += vec
    former_length = room_length

    # 사각형의 꼭짓점 생성
    pt1 = first_floor_point
    pt2 = pt1 + geo.Vector3d(room_length, 0, 0)
    pt3 = pt1 + geo.Vector3d(room_length, room_length, 0)
    pt4 = pt1 + geo.Vector3d(0, room_length, 0)

    # 꼭짓점을 리스트에 추가
    rectangle_points = [pt1, pt2, pt3, pt4, pt1]
    
    # 리스트를 Rhino에 추가
    rs.AddPolyline(rectangle_points)


'''rectangles = []
for room_dict in first_floor_rooms_sorted:
    room_name = room_dict["text"]
    room_area = room_dict["area"]
    
    room_length = math.sqrt(room_area)
    print(room_length)
    origin_point = first_floor_point
    vec_x = geo.Vector3d(room_length, 0, 0)
    vec_y = geo.Vector3d(0, room_length, 0)
    pt1 = origin_point + vec_x
    pt2 = origin_point + vec_x + vec_y
    pt3 = origin_point + vec_y
    pt4 = origin_point
    rectangles.append(geo.PolylineCurve([pt1, pt2, pt3, pt4, pt1]))
    
rectangles_sorted = []
# 각 방에 대해 반지름 계산하고 원을 생성
for room_dict in first_floor_rooms_sorted:
    room_name = room_dict["text"]
    room_area = room_dict["area"]
    
    radius = math.sqrt(room_area / math.pi)
    vec = geo.Vector3d(former_radius + radius, 0, 0)
    first_floor_point += vec
    former_radius = radius
    
    centers.append(first_floor_point)
    circles.append(geo.Circle(first_floor_point, radius))

    # 직사각형을 크기에 맞춰 생성
    rectangle_length = math.sqrt(room_area)
    vec_x = geo.Vector3d(rectangle_length, 0, 0)
    vec_y = geo.Vector3d(0, rectangle_length, 0)
    pt1 = first_floor_point - 0.5 * vec_x - 0.5 * vec_y
    pt2 = pt1 + vec_x
    pt3 = pt2 + vec_y
    pt4 = pt1 + vec_y
    rectangles_sorted.append(geo.PolylineCurve([pt1, pt2, pt3, pt4, pt1]))

'''
# ---------- end script ----------
script_2 = Script(x=curve, first_floor_point=point_3, module_start_point=point_2, origin_point=point_4)  # -> out, circles, rectangles, rectangles_by_module, momdule_rectangles; inputs first_floor_point: Point3d
# ---------- script_2: Python ----------
# -*- coding: utf-8 -*-

import rhinoscriptsyntax as rs
import scriptcontext
import Rhino
import sys
import os
import types
import imp
import math
import Rhino.Geometry as geo

our_path = "C:\\Users\\PC\\Documents\\0104workshop"
sys.path.append(our_path)

import imp
import funcs
imp.reload(funcs)
from funcs import extract
print(extract)

our_path = "C:\\Users\\PC\\Documents\\0104workshop"
sys.path.append(our_path)

import funcs

def reload_package(package):
    fn = package.__file__
    fn_dir = os.path.dirname(fn) + os.sep
    module_visit = {fn}
    def reload_recursive_ex(module):
        imp.reload(module)
        for module_child in vars(module).values():
            if isinstance(module_child, types.ModuleType):
                fn_child = getattr(module_child, "__file__", None)
                if (fn_child and 
                fn_child.startswith(fn_dir) and 
                fn_child not in module_visit):
                    module_visit.add(fn_child)
                    reload_recursive_ex(module_child)
    reload_recursive_ex(package)

import funcs
reload_package(funcs)
from funcs.extract import extract_data_to_dict, get_area, get_text_point, is_pt_inside

# 현재 Rhino 문서를 스크립트 컨텍스트의 활성 문서로 설정
scriptcontext.doc = Rhino.RhinoDoc.ActiveDoc

def find_closest_text_to_curve(curve_id, text_objects):
    # 폐곡선의 중심점 찾기
    curve_centroid = rs.CurveAreaCentroid(curve_id)[0]
    
    # 모든 텍스트 중 가장 가까운 것 찾기
    closest_text = None
    min_distance = float('inf')
    
    for text_id in text_objects:
        text_point = rs.TextObjectPoint(text_id)
        distance = rs.Distance(curve_centroid, text_point)
        
        if distance < min_distance:
            min_distance = distance
            closest_text = text_id
    
    return closest_text

def calculate_area_of_closed_curves(layer_name, text_objects):
    # 해당 레이어의 모든 폐곡선 가져오기
    curves = rs.ObjectsByLayer(layer_name, rs.filter.curve)
    
    # 결과를 저장할 딕셔너리 초기화
    result_list = []

    # 각 폐곡선에 대해 면적 계산 및 딕셔너리에 추가
    for curve_id in curves:
        closest_text_id = find_closest_text_to_curve(curve_id, text_objects)
        curve_area = rs.Area(curve_id)
        
        # 텍스트 내용 가져오기
        closest_text = rs.TextObjectText(closest_text_id)
        
        # 제외 조건: "C.H" 또는 "G.L"이 포함된 텍스트는 제외
        if "C.H" in closest_text or "G.L" in closest_text:
            continue
        
        '''# 현재 모델의 단위를 고려하여 제곱미터로 변환
        model_unit = rs.UnitSystem()
        if model_unit == 2:  # Assuming model is in millimeters
            curve_area /= 1000000  # Convert from square millimeters to square meters
        
        '''
        # 소수점 아래 자리를 버리고 면적을 정수로 변환
        curve_area = int(curve_area)
        
        # 결과 리스트에 추가
        result_list.append({"text": closest_text, "area": curve_area})
    
    return result_list, curves

def calculate_rectangle_area(length, width):
    """직사각형의 길이와 너비를 이용하여 면적을 계산합니다."""
    return length * width

layer_name = "work_area"  # 사용하려는 레이어의 이름으로 변경

# 텍스트 객체 가져오기
text_objects = rs.ObjectsByLayer("work_text", rs.filter.annotation)

# calculate_area_of_closed_curves 함수 호출하여 결과 및 curves 리스트 가져오기
result_list, curves = calculate_area_of_closed_curves(layer_name, text_objects)

# 결과 출력
for entry in result_list:
    print(f"[{entry['text']}:{entry['area']}]")

# Rhino 문서를 원래대로 복원
scriptcontext.doc = ghdoc

# first_floor_rooms 리스트 생성
first_floor_room_list = [room_dict["text"] for room_dict in result_list]
first_floor_rooms = [room_dict for room_dict in result_list if room_dict["text"] in first_floor_room_list]
print(first_floor_rooms)

# 면적 기준으로 first_floor_rooms 정렬
first_floor_rooms_sorted = sorted(first_floor_rooms, key=lambda x: x["area"], reverse=False)
print("Sorted First Floor Rooms:")
for entry in first_floor_rooms_sorted:
    print(f"[{entry['text']}:{entry['area']}]")

# 동그란 방 만들기
first_floor_point = geo.Point3d(0, 0, 0)  # 시작점 초기화
former_radius = 0
centers = []
circles = []


# 각 방에 대해 반지름 계산하고 원을 생성
for room_dict in first_floor_rooms_sorted:
    room_name = room_dict["text"]
    room_area = room_dict["area"]
    
    radius = math.sqrt(room_area / math.pi)
    vec = geo.Vector3d(former_radius + radius, 0, 0)
    first_floor_point += vec
    former_radius = radius
    
    centers.append(first_floor_point)
    circles.append(geo.Circle(first_floor_point, radius))

#사각형면적기반으로 생성
rectangle_point = first_floor_point
former_length = 0
rectangles = []
for room_dict in first_floor_rooms_sorted:

    room_name = room_dict["text"]
    room_area = room_dict["area"]

    import math
    room_length = math.sqrt(room_area)
    vec_x = geo.Vector3d(room_length, 0, 0)
    vec_y = geo.Vector3d(0, room_length, 0)

    vec = geo.Vector3d(former_length, 0, 0)
    rectangle_point += vec
    former_length = room_length

    pt1 = rectangle_point
    pt2 = pt1 + vec_x
    pt3 = pt1 + vec_x + vec_y
    pt4 = pt1 + vec_y

    rectangles.append(geo.PolylineCurve([pt1, pt2, pt3, pt4, pt1]))


#최적의 모듈 찾기
#모듈 크기 체크
#모듈로 그려준다.
module_options = [1500, 2500, 3500, 4000, 4500, 5000, 6000]

def evaluate_module(module_option):
    module_area = module_option ** 2
    area_left_list = []
    for room_dict in first_floor_rooms:
        room_area = room_dict["area"]
        area_left = room_area % (module_area / 2)
        area_left_list.append(area_left)
    return sum(area_left_list)

module_options_sorted = sorted(module_options, key=evaluate_module)
selected_module = module_options_sorted[0]
rectangles_by_module = []
x_dists = []

for room_dict in first_floor_rooms:
    room_area = room_dict["area"]
    half_module_count = int(room_area / (selected_module ** 2 / 2))
    module_count = half_module_count / 2
    vec_x = geo.Vector3d(selected_module * module_count, 0, 0)
    vec_y = geo.Vector3d(0, selected_module, 0)
    origin_point = geo.Point3d(0, 0, 0)
    x_dists.append(selected_module * module_count)
    pt0 = origin_point
    pt1 = origin_point + vec_x
    pt2 = origin_point + vec_x + vec_y
    pt3 = origin_point + vec_y
    rectangles_by_module.append(geo.PolylineCurve([pt0, pt1, pt2, pt3, pt0]))

for i, rectangle in enumerate(rectangles_by_module):
    dist_to_move = 0
    for x in range(i):
        dist_to_move += x_dists[x]
    vec = geo.Vector3d(dist_to_move, 0, 0)
    rectangle.Translate(vec)
print(rectangles_by_module)
# ---------- end script_2 ----------
curve_3 = Curve(<curve referenced from the Rhino model>)
curve_4 = Curve(<curve referenced from the Rhino model>)
curve_5 = Curve(<curve referenced from the Rhino model>)
curve_6 = Curve(<curve referenced from the Rhino model>)
script_3 = Script(room=curve_3, obstacle=curve_4, index=Slider(0, range=0..50))  # -> out, circle_curves, score_for_color
# ---------- script_3: Python ----------
import Rhino
import Rhino.Geometry as geo
from funcs.extract import is_pt_inside
from System.Drawing import Color

doc = Rhino.RhinoDoc.ActiveDoc

box = room.GetBoundingBox(geo.Plane.WorldXY)
#print(box.Min)
#print(box.Max)

#a=box.Min
origin_point = box.Min
height = box.Max.Y - box.Min.Y
width = box.Max.X - box.Min.X
print(height, width)

step = 1500
vec_x = geo.Vector3d(step, 0, 0)
vec_y = geo.Vector3d(0, step, 0)

import math
x_count = math.ceil(width / step) + 2
y_count = math.ceil(height / step) + 2
print(x_count, y_count)

points = []
for x_index in range(x_count):
    for y_index in range(y_count):
        point = origin_point + x_index * vec_x + y_index * vec_y
        if is_pt_inside(point, room):
            points.append(point)

point_score_tuple_list = []
for check_point in points:
    lines_on_point = []
    for point2 in points:
        if check_point != point2:
            check_line = geo.LineCurve(check_point, point2)
            curve_intersections = geo.Intersect.Intersection.CurveCurve(check_line, obstacle, 0.1, 0.1)
            if curve_intersections.Count == 0:
                lines_on_point.append(check_line)
    
    score = len(lines_on_point)
    point_score_tuple_list.append((check_point, score))
#print(point_score_tuple_list)

scores = [score_tuple[1] for score_tuple in point_score_tuple_list]
max_core = max(scores)
min_score = min(scores)

score_minus_min = [score - min_score for score in scores]
score_normalized = [score / max(score_minus_min) for score in score_minus_min]

score_for_color = [(score * 255) for score in score_normalized]

radius = step/2
circles = [geo.Circle(point, radius) for point in points]
print(score_for_color)

circle_curves = [circle.ToNurbsCurve()for circle in circles]

'''for i, (point, color) in enumerate(zip(points, score_for_color)):
    radius = step / 2
    
    # Rhino 문서에 원 추가
    solid_color = Color.FromArgb(int(color), 0, 255 - int(color))

    # Circle 대신 Circle 생성을 위한 평면을 사용
    circle_plane = geo.Plane(point, geo.Vector3d.ZAxis)
    circle = geo.Circle(circle_plane, radius)
    
    # 원을 추가
    circle_id=doc.Objects.AddCircle(circle, color=solid_color)'''
 

height = 5
circle_curves = [circle.ToNurbsCurve() for circle in circles]
print(circle_curves)
# ---------- end script_3 ----------
script_4 = Script(room=curve_5, obstacle=curve_6, index=Slider(0, range=0..50))  # -> out, rectangle_curves, score_for_color
# ---------- script_4: Python ----------
#print(room)
import Rhino
import Rhino.Geometry as geo
from funcs.extract import is_pt_inside
from System.Drawing import Color

doc = Rhino.RhinoDoc.ActiveDoc

box = room.GetBoundingBox(geo.Plane.WorldXY)
#print(box.Min)
#print(box.Max)

#a=box.Min
origin_point = box.Min
height = box.Max.Y - box.Min.Y
width=box.Max.X-box.Min.X
print(height,width)

step = 1000
vec_x = geo.Vector3d(step,0,0)
vec_y = geo.Vector3d(0,step,0)

import math
x_count = math.ceil(width/step)+2
y_count = math.ceil(height/step)+2
print(x_count,y_count)

points =[]
for x_index in range(x_count):
    for y_index in range(y_count):
        point = origin_point + x_index*vec_x + y_index*vec_y
        if is_pt_inside(point,room):
            points.append(point)

point_score_tuple_list = []
for check_point in points:
    lines_on_point = []
    for point2 in points:
        if check_point !=point2:
            check_line = geo.LineCurve(check_point,point2)
            curve_intersections = geo.Intersect.Intersection.CurveCurve(check_line, obstacle, 0.1 ,0.1)
            if curve_intersections.Count == 0:
                lines_on_point.append(check_line)
    score = len(lines_on_point)
    point_score_tuple_list.append((check_point,score))

print(point_score_tuple_list)

scores = [score_tuple[1] for score_tuple in point_score_tuple_list] 
max_core=max(scores)
min_score=min(scores)

score_minus_min = [score -min_score for score in scores]
score_normalized = [score /max(score_minus_min) for score in score_minus_min]
score_for_color = [(score * 255) for score in score_normalized]
######
radius = step/2
rectangles = [geo.Rectangle3d(geo.Plane.WorldXY, geo.Point3d(point.X - radius, point.Y - radius, point.Z), geo.Point3d(point.X + radius, point.Y + radius, point.Z)) for point in points]

print(score_for_color)

height = 5
rectangle_extrusions = [geo.Extrusion.Create(rectangle.ToNurbsCurve(), height, True) for rectangle in rectangles]
rectangle_curves = [rectangle.ToNurbsCurve() for rectangle in rectangles]
print(rectangle_curves)
# ---------- end script_4 ----------
rectangle = Rectangle(script.rectangles)
rectangle_2 = Rectangle(script.momdule_rectangles)
circle = Circle(script.circles)
circle_2 = Circle(script_2.circles)
geometry = Geometry(script_2.momdule_rectangles)
rectangle_3 = Rectangle(script_2.rectangles)
geometry_2 = Geometry(script_2.rectangles_by_module)
colour_rgb = ColourRGB(
    Alpha=script_4.score_for_color,
    Red=script_4.score_for_color,
    Green=script_4.score_for_color,
    Blue=script_4.score_for_color)
colour_rgb_2 = ColourRGB(
    Alpha=script_3.score_for_color,
    Red=script_3.score_for_color,
    Green=script_3.score_for_color,
    Blue=script_3.score_for_color)
create_material = CreateMaterial(Diffuse=colour_rgb_2, Specular=RGB(255, 255, 255), Emission=RGB(0, 0, 0), Transparency=0, Shine=0)
create_material_2 = CreateMaterial(Diffuse=colour_rgb, Specular=RGB(255, 255, 255), Emission=RGB(0, 0, 0), Transparency=0, Shine=0)
custom_preview = CustomPreview(Geometry=script_3.circle_curves, Material=create_material)
custom_preview_2 = CustomPreview(Geometry=script_4.rectangle_curves, Material=create_material_2)
curve_7 = Curve([<curve referenced from the Rhino model> x2])
curve_8 = Curve(<curve referenced from the Rhino model>)
script_5 = Script(room=curve_8, obstacle=curve_7, index=Slider(0, range=0..50))  # -> out, circle_curves, score_for_color
# ---------- script_5: Python ----------
import Rhino
import Rhino.Geometry as geo
from funcs.extract import is_pt_inside
from System.Drawing import Color

doc = Rhino.RhinoDoc.ActiveDoc

box = room.GetBoundingBox(geo.Plane.WorldXY)
#print(box.Min)
#print(box.Max)

#a=box.Min
origin_point = box.Min
height = box.Max.Y - box.Min.Y
width = box.Max.X - box.Min.X
print(height, width)

step = 1500
vec_x = geo.Vector3d(step, 0, 0)
vec_y = geo.Vector3d(0, step, 0)

import math
x_count = math.ceil(width / step) + 2
y_count = math.ceil(height / step) + 2
print(x_count, y_count)

points = []
for x_index in range(x_count):
    for y_index in range(y_count):
        point = origin_point + x_index * vec_x + y_index * vec_y
        if is_pt_inside(point, room):
            points.append(point)

point_score_tuple_list = []
for check_point in points:
    lines_on_point = []
    for point2 in points:
        if check_point != point2:
            check_line = geo.LineCurve(check_point, point2)
            curve_intersections = geo.Intersect.Intersection.CurveCurve(check_line, obstacle, 0.1, 0.1)
            if curve_intersections.Count == 0:
                lines_on_point.append(check_line)
    
    score = len(lines_on_point)
    point_score_tuple_list.append((check_point, score))
print(point_score_tuple_list)

scores = [score_tuple[1] for score_tuple in point_score_tuple_list]
max_core = max(scores)
min_score = min(scores)

score_minus_min = [score - min_score for score in scores]
score_normalized = [score / max(score_minus_min) for score in score_minus_min]

score_for_color = [(score * 255) for score in score_normalized]
radius = step/2
circles = [geo.Circle(point, radius) for point in points]
print(score_for_color)

height = 5
circle_curves = [circle.ToNurbsCurve() for circle in circles]
print(circle_curves)
# ---------- end script_5 ----------
colour_rgb_3 = ColourRGB(
    Alpha=script_5.score_for_color,
    Red=script_5.score_for_color,
    Green=script_5.score_for_color,
    Blue=script_5.score_for_color)
create_material_3 = CreateMaterial(Diffuse=colour_rgb_3, Specular=colour_rgb_3, Emission=colour_rgb_3, Transparency=colour_rgb_3, Shine=colour_rgb_3)
custom_preview_3 = CustomPreview(Geometry=script_5.circle_curves, Material=create_material_3)
