# Grasshopper definition my_script.gh (Grasshopper 1.0.7)
# plug-ins: RhinoCodePluginGH

crv = Curve(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)
crv_2 = Curve(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)
S = Script(interval=Slider(1200, range=0..10000), boundary=crv, obstacle=crv_2)  # -> out, a, b; inputs interval: Int32, boundary: Curve, obstacle: Curve
# ---------- S: Python ----------
import Rhino
import Rhino.Geometry as geo
import math
import sys
sys.path.append('C:\\Users\\JI\\Documents\\project-junglim-1')
from changmin.extract import is_pt_inside

box = boundary.GetBoundingBox(geo.Plane.WorldXY)
origin_point = box.Min
height = box.Max.Y - box.Min.Y
width = box.Max.X - box.Min.X

vec_x = geo.Vector3d(interval, 0, 0)
vec_y = geo.Vector3d(0, interval, 0)

x_count = math.ceil(width/interval)+1
y_count = math.ceil(height/interval)+1

pts = []
for y_index in range(y_count):
    for x_index in range(x_count):
        point = origin_point + x_index*vec_x + y_index*vec_y
        if is_pt_inside(point, boundary):
            pts.append(point)

point_score_tuple_list = []
for check_point in pts:
    lines_on_point = []
    for otherpoint in pts:
        if check_point != otherpoint:
            check_line = geo.LineCurve(check_point,otherpoint)
            curve_intersections = geo.Intersect.Intersection.CurveCurve(check_line, obstacle, 0.1, 0.1)
            if curve_intersections.Count == 0:
                lines_on_point.append(check_line)
    score = len(lines_on_point)
    point_score_tuple_list.append((check_point, score))
scores = [score_tuple[1] for score_tuple in point_score_tuple_list]

max_score = max(scores)
min_score = min(scores)

score_minus_min = [score -min_score for score in scores]
socre_normalized = [score / max(score_minus_min) for score in score_minus_min]
score_for_color = [int(score*255) for score in socre_normalized]
print(score_for_color)

mesh = geo.Mesh()
for i in range(len(pts)):
    v1 = mesh.Vertices.Add(pts[i] - (vec_x/2) - (vec_y/2))
    v2 = mesh.Vertices.Add(pts[i] + (vec_x/2) - (vec_y/2))
    v3 = mesh.Vertices.Add(pts[i] + (vec_x/2) + (vec_y/2))
    v4 = mesh.Vertices.Add(pts[i] - (vec_x/2) + (vec_y/2))
    face_indices = [v1, v2, v3, v4]
    color = score_for_color[i]
    for index in face_indices:
        mesh.VertexColors.Add(color,color,color)
    mesh.Faces.AddFace(*face_indices)

mesh.Normals.ComputeNormals()

a = mesh
b = pts
print(pts[0].X)
print(origin_point)
# ---------- end S ----------
pt = Point(S.b)
