# Grasshopper definition 240111_space_syntax.gh (Grasshopper 1.0.7)
# plug-ins: RhinoCodePluginGH

# ---- group: Test
crv = Curve(<curve referenced from the Rhino model>)
crv_2 = Curve(<curve referenced from the Rhino model>)
S = Script(space=crv_2, obstacle=crv)  # -> out, bbox, points, circles, rectangles, rec_extrusion, asd, space_extrusion, valid_extrusion_brep, colorlizing; inputs x: Curve, obstacle: Curve
# ---------- S: Python ----------
import Rhino
import Rhino.Geometry as geo
import math
import funcs
import Grasshopper
from Grasshopper.Kernel import *
from funcs.area_table_def import is_pt_inside_curve

# 과제1
bbox = space.GetBoundingBox(geo.Plane.WorldXY)
width = bbox.Max.X-bbox.Min.X
height = bbox.Max.Y-bbox.Min.Y

step = 2000
vec_x = geo.Vector3d(step,0,0)
vec_y = geo.Vector3d(0,step,0)

x_count = math.ceil(width/step) + 2
y_count = math.ceil(height/step) + 2

origin_point = bbox.Min
points = []
for i in range(x_count):
    for j in range(y_count):
        point = origin_point + i*vec_x + j*vec_y
        # if is_pt_inside_curve(point,space):
        points.append(point)

point_and_connectivity_tuple = []
for i in points:
    valid_lines =[]
    for j in points:
        if i != j:
            line = geo.LineCurve(i,j)
            intersection_check = geo.Intersect.Intersection.CurveCurve(line,obstacle,0.001,0.001) 
            if intersection_check.Count == 0:
                valid_lines.append(line)
    valid_lines_count = len(valid_lines)
    point_and_connectivity_tuple.append((i,valid_lines_count))

connectivity_list = [point_and_connectivity[1] for point_and_connectivity in point_and_connectivity_tuple]
highest_value = max(connectivity_list)
lowest_value = min(connectivity_list)

normalized_connectiviey = []
minus_value = [value - lowest_value for value in connectivity_list]
nomalization = [value/max(minus_value) for value in minus_value]
colorlizing = [int(value*255) for value in nomalization]
# print(minus_value)
# print(nomalization)
# print(colorlizing)

rectangles =[]
half_width = step/2
half_height = step/2
for i in range(len(points)):
    pt1 = geo.Point3d(points[i].X - half_width, points[i].Y - half_height, points[i].Z)
    pt2 = geo.Point3d(points[i].X + half_width, points[i].Y - half_height, points[i].Z)
    pt3 = geo.Point3d(points[i].X + half_width, points[i].Y + half_height, points[i].Z)
    pt4 = geo.Point3d(points[i].X - half_width, points[i].Y + half_height, points[i].Z)
    rectangles.append(geo.PolylineCurve([pt1, pt2, pt3, pt4, pt1]))

asd = [geo.Curve.CreateBooleanIntersection(space, rectangles[i],0.001) for i in range(len(rectangles))]
print(asd)


# print(type(space))
# height = 5
# space_extrusion = geo.Extrusion.Create(space, 500, True).ToBrep()
# space_extrusion_transform = space_extrusion.Transform(geo.Transform.Translation(geo.Vector3d(0,0,250)))
# print(space_extrusion.IsSolid)
# rec_extrusion = [geo.Extrusion.Create(rectangles[i], height, True).ToBrep() for i in range(len(rectangles))]
# print(rec_extrusion[1].IsSolid)
# valid_extrusion = [geo.Brep.CreateBooleanIntersection(rec_extrusion[i],space_extrusion, 0.001) for i in range(len(rec_extrusion))]
# print(valid_extrusion[0])

# valid_extrusion_brep = []
# for item in valid_extrusion:
#     z = Grasshopper.Kernel.Types.GH_Brep()
#     GH_Convert.ToGHBrep(item,GH_Conversion.Both,z)
#     valid_extrusion_brep.append(z)
# print(valid_extrusion_brep[1])

# join_valid_extrusion = [geo.Brep.JoinBreps(valid_extrusion[i],0.001) for i in range(len(valid_extrusion))]
# print(join_valid_extrusion[2])



# bbox로 사각형 만들기
# radius = step/2
# circles = [geo.Circle(point, radius) for point in points]
# rectangles = [circles[i].BoundingBox.GetEdges() for i in range(len(circles))]
# print(type(rectangles[0]))

# rectangles_brep = [geo.Brep.CreateFromBox(rectangles[i]) for i in range(len(rectangles))]
# print(geo.Brep.CreateFromBox(rectangles[0]))

# box_extrusion = [geo.Extrusion.CreateBoxExtrusion(rectangles[i]) for i in range(len(rectangles))]
# print(type(box_extrusion[0]))
# intersection_box = []
# for i in range(len(rectangles)):
#     intersection_check = geo.Intersect.Intersection.CurveCurve(space,rectangles2[i],0.001,0.001)
#     if intersection_check.Count  >=  1:
#         intersection_box.append(rectangles2[i])

# obstacle_brep = geo.Extrusion.Create(obstacle, height, True).ToBrep()

#  rectangle = geo.PolylineCurve([pt1, pt2, pt3, pt4, pt1])
#     intersection_check = geo.Intersect.Intersection.CurveCurve(rectangle,obstacle,0.001,0.001)
#     if intersection_check.Count <= 1:

# obstacle_brep = geo.Extrusion.Create(obstacle, 5, True).ToBrep()
# print(type(obstacle_brep))
# obstacle_bbox = obstacle.GetBoundingBox(geo.Plane.WorldXY)
# ---------- end S ----------
circle = Circle(S.circles)
box = Box(S.bbox)
crv_3 = Curve(S.rectangles)
brep = Brep(S.rec_extrusion)
pt = Point(S.points)
brep_2 = Brep(S.space_extrusion)
brep_3 = Brep(S.valid_extrusion_brep)
crv_4 = Curve(S.asd)

# ----
pt_2 = Point(<point referenced from the Rhino model>)
pt_3 = Point(<point referenced from the Rhino model>)
pt_4 = Point(<point referenced from the Rhino model>)

# ---- group: Space Syntax
S_2 = Script()  # -> out, a
# ---------- S_2: Python ----------
import Rhino.Geometry as Geometry

1. 방을 정의
네모를 만든다.(in Rhino/room)
커브로 연결 (in grass)
네모 안에 장애물 만들기 (in Rhino / obstacle)

기준점을 만들 때는 bbox를 주로 사용
바운딩박스는 좌측아래의 최소점, 우측위의 최대점으로 만든다.

간격을 정할 때, 시작은 크게.
박스 크기에 따라 step(간격) 설정

높이와 폭은 최소 최대의 뺼셈을 통해

point_origin + vec_x + vec_y
벡터엑스와 벡터와이 정의

x_count와 y_count로 정의
점의 개수를 정할 때 나머지가 최소가되는 step을 찾자!

기존에 만들었던 함수를 이용해서 내부 point 만을 남기자

선 그어주기
LineCurve

intersection 체크하기
Rhinocommon.intersection
method 확인 늘 return 확인
Count

그래스호퍼 속성 설정 커브인지 인트인지
슬라이더 사용

if 구문 확인 ==0
Count가 0인 것 찾기

겹치는 않는 것 for 구문으로 찾기
min.max 구하기

노말라이즈 하기

표현하기(네모, 동그라미 뭐든 좋다.)

동그라미일 경우
radius = step/2
리스트 컴프리헨션 사용하자!

Extrusion Class 활용

그래스호퍼 내에서 컬러를 입히는건 번거로워

priview 컴포넌트 활용
RGM/MATERIAL 만들기

그라데이션으로 표현할 수 없을까?

그래스호퍼로 색깔mapping하는법은 검색하면 많다!

과제는 이를 구현하기

또 다른 과제는

룸과 장애물이 같은 객체일 때
방 2개에 문이 뚫렸을 떄를 가정

Side Project의 목적과 의의

이전 학생

나무 심기를 보로노이 패턴으로 구체화하고 산책로까지.
another
콘타만들기 / 창문만들기

우리는 기획서 만들기!
혼자 끌고나갈 프로그램 만들기
잠깐잠깐 봐줄 수 있다.

다음엔 우리가 어떤 작업을 하고 싶은지 기획서 정리하기.

근본없더라도 하고 싶은 바를 명확히 보여주는 것을 기대.
그리고 예측까지 해보기.

어떤 공부를 할 수 있는가.
어떤 진로를 갈 수 있는가.

코딩의 습관화를 기대!
설계자동화하는 것보다, 초기엔 잘썼던건 엑셀_파이썬 같은 기능

다음 과제는 방으로 만들기
Github 활용하기

Mesh에 Material(Color)을 태울 수 있다.
# ---------- end S_2 ----------

# ----
test = Script()  # -> out, a
# ---------- test: Python ----------
import Rhino
import Rhino.Geometry as geo

def extract_data_to_dict():
    layers = Rhino.RhinoDoc.ActiveDoc.Layers
    object_list = Rhino.RhinoDoc.ActiveDoc.Objects

    object_by_layer = {}

    for layer in layers:
        object_by_layer[layer.Name] = []

    for obj in object_list:
        for layer in layers:
            if layer.Index == obj.Attributes.LayerIndex:
                object_by_layer[layer.Name].append(obj)
    return object_by_layer

layer_object_dict = extract_data_to_dict()

# Area = layer_object_dict["A-AREA-21"]
# for i in range(len(Area)):
#     print((Area[i]).Geometry)

# print(Rhino.Geometry.AreaMassProperties.Compute(Area[3].Geometry).Area)

Text = layer_object_dict["Xref-TEXT"]
for i in range(len(Text)):
    print((Text[i]).Geometry.Plane.Origin)

# print(Text[1].Geometry)

# for i in range(len(Area)):
#     print(Area[i].Contains(Text[1], geo.Plane.WorldXY, 0.001))

# area_table_dataframe = {}

# area_value = []
# for i in range(len(area_table)):
#     area_value.append(area_table[i][1])
# # area_value.sort(reverse=True)
# print(area_value)
# area_table_dataframe["area(㎡)"] = area_value

# roomname_value = []
# for i in range(len(area_table)):
#     roomname_value.append(area_table[i][0])
# print(roomname_value)
# ---------- end test ----------

# ---- group: Main
S_3 = Script(circle_start_point=pt_3, rectangle_start_point=pt_2, module_start_point=pt_4)  # -> out, circles, rectangles, rooms; inputs x: Point3d
# ---------- S_3: Python ----------
import sys
import imp
import Rhino
import Rhino.Geometry as geo
import os
import types
import math

our_path = "C:\\Users\\82108\\Desktop\\설계자동화워크샵\\과제\\6.Session3_Automation 2"
sys.path.append(our_path)

def reload_package(package):
    print(package)
    fn = package.__file__
    fn_dir = os.path.dirname(fn) + os.sep
    module_visit = {fn}
    def reload_recursive_ex(module):
        imp.reload(module)
        for module_child in vars(module).values():
            if isinstance(module_child, types.ModuleType):
                fn_child = getattr(module_child, "__file__", None)
                if (fn_child and 
                fn_child.startswith(fn_dir) and 
                fn_child not in module_visit):
                    #print("reloading:", fn_child, "from", module)
                    module_visit.add(fn_child)
                    reload_recursive_ex(module_child)
    
    reload_recursive_ex(package)

import funcs
reload_package(funcs)
from funcs.area_table_def import extract_data_to_dict, get_area, get_text_point, is_pt_inside_curve

object_dict = extract_data_to_dict()

area_objects = object_dict["A-AREA-21"]
text_objects = object_dict["Xref-TEXT"]

text_entity_list =[]
for text_object in text_objects:
    room_name = text_object.Geometry.PlainText
    if "UP" in room_name or "DN" in room_name:
       pass
    else:
        text_entity_list.append(text_object.Geometry)

area_table = []
for curve_object in area_objects:
    curve_geometry = curve_object.Geometry
    area = round(get_area(curve_geometry))# (*(10**(-6)),3)
    for text in text_entity_list:
        text_center = get_text_point(text)
        if is_pt_inside_curve(text_center, curve_geometry):
            area_table.append((text.PlainText, area))
# print(area_table)


#240108
room_list = ['계단실', '화장실', '복도 및 Elev 홀', '장애인용 화장실', '사무실']
room_area_table = [roomname for roomname in area_table if roomname[0] in room_list]
# print(room_area_table)
room_area_table.sort(key = lambda k: k[1])
# print(room_area_table)

#과제1
circles = []
centers = []
circle_center = circle_start_point
former_radius = 0
for name, area in room_area_table:
    radius = ((area/math.pi)**(1/2))
    translate = geo.Vector3d(former_radius+radius,0,0)
    circle_center += translate
    former_radius = radius
    centers.append(circle_center)
    circles.append(geo.Circle(circle_center, radius))

#과제2
rectangles = []
former_rectangle_edge = 0
origin_point = rectangle_start_point
for name, area in room_area_table:
    rectangle_edge = area**(1/2)
    vec_x = geo.Vector3d(rectangle_edge,0,0)
    vec_y = geo.Vector3d(0,rectangle_edge,0)
    pt1 = origin_point
    pt2 = origin_point + vec_x
    pt3 = origin_point + vec_x + vec_y
    pt4 = origin_point + vec_y
    translate = geo.Vector3d(former_rectangle_edge+rectangle_edge,0,0)
    origin_point += translate
    rectangles.append(geo.PolylineCurve([pt1, pt2, pt3, pt4, pt1]))


#과제3
# 1. 최적의 모듈 찾기 (함수를 활용하지 않는 방법으로 해보기)
module_options = [2100, 2400, 2700, 3000, 3300, 3600, 3900, 4200, 4500]
module_left_list = []
for module_option in module_options:
    module_area = module_option**2
    area_left_list =[]
    for name, area in room_area_table:
        area_left = area % (module_area/4) # 반모듈
        area_left_list.append(area_left)
    module_left_list.append((module_option, int(sum(area_left_list))))
# print(module_left_list)
module_left_list.sort(key = lambda k: k[1])

selected_module = module_left_list[0][0]
# print(selected_module)

# 2. 각 방에 대한 모듈 개수 구하기
module_counts = {}
for name, area in room_area_table:
    module_count = area/(selected_module**2)
    module_counts[name] = round(module_count)
# print(module_counts)

# 3. 모듈 개수에 따라 방 만들기
rooms = []
former_room_edge = 0
origin_point = module_start_point
for name, area in room_area_table:
    room_edge = selected_module*module_counts[name]
    vec_x = geo.Vector3d(room_edge,0,0)
    vec_y = geo.Vector3d(0,selected_module,0)
    pt1 = origin_point
    pt2 = origin_point + vec_x
    pt3 = origin_point + vec_x + vec_y
    pt4 = origin_point + vec_y
    translate = geo.Vector3d(former_room_edge+room_edge,0,0)
    origin_point += translate
    rooms.append(geo.PolylineCurve([pt1, pt2, pt3, pt4, pt1]))
# ---------- end S_3 ----------

# ---- group: Test / colorlizing
rgb = ColourRGB(Alpha=255, Red=S.colorlizing, Green=0, Blue=0)
material = CreateMaterial(Diffuse=rgb, Specular=RGB(255, 255, 255), Emission=RGB(0, 0, 0), Transparency=0, Shine=0)
preview = CustomPreview(Geometry=S.rec_extrusion, Material=material)

# ----
crv_5 = Curve(S_3.rectangles)
crv_6 = Curve(S_3.circles)
crv_7 = Curve(S_3.rooms)

# ---- group: 과제1
crv_8 = Curve(<curve referenced from the Rhino model>)
crv_9 = Curve(<curve referenced from the Rhino model>)
S_4 = Script(space=crv_9, obstacle=crv_8)  # -> out, points, circles, rectangles, rec_extrusion, colorlizing; inputs x: Curve, obstacle: Curve
# ---------- S_4: Python ----------
import Rhino.Geometry as geo
import math
import funcs
from funcs.area_table_def import is_pt_inside_curve

# 과제1
bbox = space.GetBoundingBox(geo.Plane.WorldXY)
width = bbox.Max.X-bbox.Min.X
height = bbox.Max.Y-bbox.Min.Y

step = 1000
vec_x = geo.Vector3d(step,0,0)
vec_y = geo.Vector3d(0,step,0)

x_count = math.ceil(width/step)
y_count = math.ceil(height/step)

origin_point = bbox.Min
points = []
for i in range(x_count):
    for j in range(y_count):
        point = origin_point + i*vec_x + j*vec_y
        if is_pt_inside_curve(point,space):
            points.append(point)

point_and_connectivity_tuple = []
for i in points:
    valid_lines =[]
    for j in points:
        if i != j:
            line = geo.LineCurve(i,j)
            intersection_check = geo.Intersect.Intersection.CurveCurve(line,obstacle,0.001,0.001) 
            if intersection_check.Count == 0:
                valid_lines.append(line)
    valid_lines_count = len(valid_lines)
    point_and_connectivity_tuple.append((i,valid_lines_count))

connectivity_list = [point_and_connectivity[1] for point_and_connectivity in point_and_connectivity_tuple]
highest_value = max(connectivity_list)
lowest_value = min(connectivity_list)

normalized_connectiviey = []
minus_value = [value - lowest_value for value in connectivity_list]
nomalization = [value/max(minus_value) for value in minus_value]
colorlizing = [int(value*255) for value in nomalization]

rectangles =[]
half_width = step/2
half_height = step/2
for i in range(len(points)):
    pt1 = geo.Point3d(points[i].X - half_width, points[i].Y - half_height, points[i].Z)
    pt2 = geo.Point3d(points[i].X + half_width, points[i].Y - half_height, points[i].Z)
    pt3 = geo.Point3d(points[i].X + half_width, points[i].Y + half_height, points[i].Z)
    pt4 = geo.Point3d(points[i].X - half_width, points[i].Y + half_height, points[i].Z)
    rectangles.append(geo.PolylineCurve([pt1, pt2, pt3, pt4, pt1]))

height = 5
rec_extrusion = [geo.Extrusion.Create(rectangles[i], height, True) for i in range(len(rectangles))]
# ---------- end S_4 ----------
pt_5 = Point(S_4.points)
circle_2 = Circle(S_4.circles)
crv_10 = Curve(S_4.rectangles)
brep_4 = Brep(S_4.rec_extrusion)

# ---- group: 과제1 / colorlizing
rgb_2 = ColourRGB(Alpha=255, Red=S_4.colorlizing, Green=0, Blue=0)
material_2 = CreateMaterial(Diffuse=rgb_2, Specular=RGB(255, 255, 255), Emission=RGB(0, 0, 0), Transparency=0, Shine=0)
preview_2 = CustomPreview(Geometry=S_4.rec_extrusion, Material=material_2)

# ----
crv_11 = Curve(<curve referenced from the Rhino model>)
crv_12 = Curve(<curve referenced from the Rhino model>)
crv_13 = Curve(<curve referenced from the Rhino model>)
S_5 = Script(space1=crv_11, space2=crv_12, obstacle=crv_13)  # -> out, bbox, points, circles, rectangles, rec_extrusion, colorlizing; inputs x: Curve, obstacle: Curve
# ---------- S_5: Python ----------
import Rhino.Geometry as geo
import math
import funcs
from funcs.area_table_def import is_pt_inside_curve

# 과제2
bbox1 = space1.GetBoundingBox(geo.Plane.WorldXY)
bbox2 = space2.GetBoundingBox(geo.Plane.WorldXY)
bbox = geo.BoundingBox.Union(bbox1,bbox2) 
width = bbox.Max.X-bbox.Min.X
height = bbox.Max.Y-bbox.Min.Y

step = 1000
vec_x = geo.Vector3d(step,0,0)
vec_y = geo.Vector3d(0,step,0)

x_count = math.ceil(width/step)
y_count = math.ceil(height/step)

origin_point = bbox.Min
points = []
for i in range(x_count):
    for j in range(y_count):
        point = origin_point + i*vec_x + j*vec_y
        if is_pt_inside_curve(point, space1):
            points.append(point)
        if is_pt_inside_curve(point, space2):
            points.append(point)


point_and_connectivity_tuple = []
for i in points:
    valid_lines =[]
    for j in points:
        if i != j:
            line = geo.LineCurve(i,j)
            intersection_check = geo.Intersect.Intersection.CurveCurve(line,obstacle,0.001,0.001)
            if intersection_check.Count == 0:
                valid_lines.append(line)
    valid_lines_count = len(valid_lines)
    point_and_connectivity_tuple.append((i,valid_lines_count))

connectivity_list = [point_and_connectivity[1] for point_and_connectivity in point_and_connectivity_tuple]
highest_value = max(connectivity_list)
lowest_value = min(connectivity_list)

normalized_connectiviey = []
minus_value = [value - lowest_value for value in connectivity_list]
nomalization = [value/max(minus_value) for value in minus_value]
colorlizing = [int(value*255) for value in nomalization]

rectangles =[]
half_width = step/2
half_height = step/2
for i in range(len(points)):
    pt1 = geo.Point3d(points[i].X - half_width, points[i].Y - half_height, points[i].Z)
    pt2 = geo.Point3d(points[i].X + half_width, points[i].Y - half_height, points[i].Z)
    pt3 = geo.Point3d(points[i].X + half_width, points[i].Y + half_height, points[i].Z)
    pt4 = geo.Point3d(points[i].X - half_width, points[i].Y + half_height, points[i].Z)
    rectangles.append(geo.PolylineCurve([pt1, pt2, pt3, pt4, pt1]))

height = 5
rec_extrusion = [geo.Extrusion.Create(rectangles[i], height, True).ToBrep() for i in range(len(rectangles))]
# ---------- end S_5 ----------

# ---- group: colorlizing
rgb_3 = ColourRGB(Alpha=255, Red=S_5.colorlizing, Green=0, Blue=0)
material_3 = CreateMaterial(Diffuse=rgb_3, Specular=RGB(255, 255, 255), Emission=RGB(0, 0, 0), Transparency=0, Shine=0)
preview_3 = CustomPreview(Geometry=S_5.rec_extrusion, Material=material_3)

# ----
box_2 = Box(S_5.bbox)
pt_6 = Point(S_5.points)
circle_3 = Circle(S_5.circles)
crv_14 = Curve(S_5.rectangles)
brep_5 = Brep(S_5.rec_extrusion)
